# Grasshopper definition 20191015 start.gh (Grasshopper 1.0.7)

ghpython_script = GhPythonScript(z=Slider(0.7, range=0..1), y=Slider(0.7, range=0..1))  # -> out, a
# ---------- ghpython_script: Python ----------
__author__ = "kkkxy"
__version__ = "2019.10.15"

import rhinoscriptsyntax as rs


average = (z + y) * 0.5 #inner calculato
a = average #a is the output tool
# ---------- end ghpython_script ----------
ghpython_script_2 = GhPythonScript(z=Slider(5.3, range=0..10), y=Slider(0, range=0..100), x=Slider(0, range=0..100))  # -> out, a
# ---------- ghpython_script_2: Python ----------
__author__ = "kkkxy"
__version__ = "2019.10.15"

import rhinoscriptsyntax as rs
import Rhino.Geometry as rg

myPoint = rg.Point3d(x, y, z) 
#datatype: Point3d/same of the name of commend
a = myPoint
# ---------- end ghpython_script_2 ----------
panel = Panel(ghpython_script.a)
panel_2 = Panel(ghpython_script_2.a)
