# Grasshopper definition 20191023 List Loop.gh (Grasshopper 1.0.7)
# plug-ins: Bifocals

panel = Panel("Loop_CreatePt")
panel_2 = Panel("List_Pt")
panel_3 = Panel("CreatePt")
panel_4 = Panel("MidPt")
panel_5 = Panel("List_Text")
panel_6 = Panel("Loop_Spiral")
panel_7 = Panel("Lists & Loops")
panel_8 = Panel("Find_Similar_Direction_line")
panel_9 = Panel("Find_Pt_inside_Circle")
panel_10 = Panel("Nested_Loops")
panel_11 = Panel("Create_2d_grid_wave_lines")
panel_12 = Panel("Create_2d_grid_wave_points")
panel_13 = Panel("Create_2d_grid_wave_surface")
panel_14 = Panel("Create_2d_grid_points")
point = Point(<point referenced from the Rhino model>)
point_2 = Point(<point referenced from the Rhino model>)
ghpython_script = GhPythonScript()  # -> out, a
# ---------- ghpython_script: Python ----------
import Rhino.Geometry as rg
import rhinoscriptsyntax as rs

#01.List
heroes = ["Batman", "Wolverine", "Superman"]
print heroes 
getfirsthero = heroes[0]
getlasthero = heroes[-1]

sublist = heroes[0:2] #create a smaller list from 0 to 1(value before 2)

heroes[1] = "Thor" #change the 1 position's value to Thor
heroes.append("Captain America") #add a single new element to the list
heroes.extend(["Ant Man","Robin"]) #add a new list to the list
heroes.insert(1, "Hulk") #add one element in front of P1/tp become the new P1
heroes.remove("Superman") #delete the first Superman element

#insert and remove need a shift operation, they are expensive, we do not use it so much.

getnumber = heroes.count("Batman") 
heroes.sort() # sort the items 
heroes.reverse() #Reverse the list
getlength = len(heroes)
# ---------- end ghpython_script ----------
ghpython_script_2 = GhPythonScript()  # -> out, oPoints
# ---------- ghpython_script_2: Python ----------
import Rhino.Geometry as rg

points = []
points.append(rg.Point3d(1.0, 1.0, 0.0))
points.append(rg.Point3d(2.0, 2.0, 0.0))
points.append(rg.Point3d(3.0, 3.0, 0.0))
points.append(rg.Point3d(4.0, 4.0, 0.0))

oPoints = points
# ---------- end ghpython_script_2 ----------
panel_16 = Panel("compare angle")
panel_17 = Panel("compare radius")
ghpython_script_3 = GhPythonScript()  # -> out, oPt
# ---------- ghpython_script_3: Python ----------
import Rhino.Geometry as rg
import rhinoscriptsyntax as rs

points = []
for i in range(0,50):
    myPoint = rg.Point3d(i,i,0)
    points.append(myPoint)

oPt = points
# ---------- end ghpython_script_3 ----------
point_3 = Point(ghpython_script_2.oPoints)
ghpython_script_4 = GhPythonScript(A=point, B=point_2)  # -> out, M; inputs A: Point3d, B: Point3d
# ---------- ghpython_script_4: Python ----------
import Rhino.Geometry as rg

midX = 0.5*(A.X + B.X)#Every Point3D has attributes/propeties X,Y,Z
midY = 0.5*(A.Y + B.Y)
midZ = 0.5*(A.Z + B.Z)

M = rg.Point3d(midX, midY, midZ)

distance = A.DistanceTo(B)#the distance bt two points

print distance #directly print will go to 'out'

#Remember to change Type hint to Point3D! Otherwise u will get an error.
# ---------- end ghpython_script_4 ----------
point_4 = Point(ghpython_script_3.oPt)
ghpython_script_5 = GhPythonScript(z=Slider(4.9, range=0..10), y=Slider(12.5, range=0..100), x=Slider(513, range=0..1000))  # -> out, myPoint
# ---------- ghpython_script_5: Python ----------
import Rhino.Geometry as rg

myPoint = rg.Point3d(x, y, z)  #create a point given 3 number inputs
# ---------- end ghpython_script_5 ----------
panel_18 = Panel(ghpython_script_4.out)
ghpython_script_6 = GhPythonScript()  # -> out, a
# ---------- ghpython_script_6: Python ----------
import rhinoscriptsyntax as rs
import Rhino.Geometry as rg
import math

for i in range(0,2):
    print "i = " + i #+ means to attach the letters 
    for j in range(0,3):
        print " j = " + J
# ---------- end ghpython_script_6 ----------
ghpython_script_7 = GhPythonScript()  # -> out, oGeometry
# ---------- ghpython_script_7: Python ----------
import Rhino.Geometry as rg
import math
curves = []

for i in range(0,100,2):
    points = []
    for j in range(0,100,2):
        z = 4*math.sin(0.1*i)*math.sin(0.15*j)
        points.append(rg.Point3d(i,j,z))
    curve = rg.NurbsCurve.CreateInterpolatedCurve(points,3)
    curves.append(curve)
    

oGeometry = curves
# ---------- end ghpython_script_7 ----------
ghpython_script_8 = GhPythonScript()  # -> out, oGeometry
# ---------- ghpython_script_8: Python ----------
import Rhino.Geometry as rg
import math

points = []

for i in range(0,100,2):
    for j in range(0,100,2):
        z = 3*math.sin(0.1*i)*math.sin(0.1*j)
        points.append(rg.Point3d(i,j,z))
        
oGeometry = points
# ---------- end ghpython_script_8 ----------
ghpython_script_9 = GhPythonScript()  # -> out, oGeometry
# ---------- ghpython_script_9: Python ----------
import Rhino.Geometry as rg
import math
curves = []

for i in range(0,100,2):
    points = []
    for j in range(0,100,2):
        z = 4.5*math.sin(0.15*i)*math.sin(0.15*j)
        points.append(rg.Point3d(i,j,z))
    curve = rg.NurbsCurve.CreateInterpolatedCurve(points,3)
    curves.append(curve)
    
breps = rg.Brep.CreateFromLoft(curves, rg.Point3d.Unset,rg.Point3d.Unset, rg.LoftType.Normal, False)
oGeometry = breps # brep is a list od objects,is a static data type

#Normal commend is uesd afeter u have the object, but the static one can start without object like brep
#static function need to say the class first

# mypoint.DistanceTo(yourpoint)
# ---------- end ghpython_script_9 ----------
ghpython_script_10 = GhPythonScript()  # -> out, oGeometry
# ---------- ghpython_script_10: Python ----------
import Rhino.Geometry as rg
import math

points = []

for i in range(0,100,2):
    for j in range(0,100,2):
        points.append(rg.Point3d(i,j,0.0))
        
oGeometry = points
# ---------- end ghpython_script_10 ----------
ghpython_script_11 = GhPythonScript(iAngle=Slider(3.1, range=0.1..3.1))  # -> out, oPoint, oCurve
# ---------- ghpython_script_11: Python ----------
import Rhino.Geometry as rg
import rhinoscriptsyntax as rs
import math

points = []
for i in range(0,150):
    alpha = i * iAngle
    x = 0.5*i*math.cos(alpha)
    y = 0.5*i*math.sin(alpha)
    z = i * 0.8
    points.append(rg.Point3d(x,y,z))

oPoint = points
oCurve = rg.NurbsCurve.CreateInterpolatedCurve(points, 3)
# ---------- end ghpython_script_11 ----------
ghpython_script_12 = GhPythonScript()  # -> out, oGeometry
# ---------- ghpython_script_12: Python ----------
import Rhino.Geometry as rg
import math
points = []

for i in range(300,400,2):
    row = []
    for j in range(300,400,2):
        z = 3*math.sin(0.1*i)*math.sin(0.1*j)
        row.append(rg.Point3d(i,j,z))
    points.append(row)
#ouput a list of lists, python will only unpack the first layer so It will not show points
# ---------- end ghpython_script_12 ----------
panel_19 = Panel(ghpython_script_5.myPoint)
list_item = ListItem(List=ghpython_script_7.oGeometry, Index=0, Wrap=True)
point_5 = Point(ghpython_script_8.oGeometry)
point_6 = Point(ghpython_script_10.oGeometry)
brep = Brep(ghpython_script_9.oGeometry)
point_7 = Point(ghpython_script_11.oPoint)
curve = Curve(ghpython_script_11.oCurve)
curve_2 = Curve(ghpython_script_7.oGeometry)
panel_20 = Panel(point_7)
ghpython_script_13 = GhPythonScript(iPoint=point_7)  # -> out, oSpheres; inputs iPoint: list of Point3d
# ---------- ghpython_script_13: Python ----------
import Rhino.Geometry as rg
import math

spheres = []
for i in range(0, len(iPoint)):
    center = iPoint[i]
    r = 2 + 0.75*math.cos(i)
    mySphere = rg.Sphere(center, r)
    spheres.append(mySphere)
    
oSpheres = spheres
# ---------- end ghpython_script_13 ----------
