# Grasshopper definition 20191029 nested lines.gh (Grasshopper 1.0.7)

# 20191029 Nested lists dunctions...
panel = Panel("Nested_lists")
panel_2 = Panel("Lines from points")
panel_3 = Panel("Random_Points_Generator")
panel_4 = Panel("Random_Number_Generator")
panel_5 = Panel("Random_Color_Generator")
panel_6 = Panel("Random_OffsetPt_Generator")
panel_7 = Panel("Create_2d_grid_wave_surface")
ghpython_script = GhPythonScript()  # -> out, a
# ---------- ghpython_script: Python ----------
#Matrix can be descirbed in a nested list
myMatrix = [[0,2,4],[1,3,5]]
item = mymatrix[0][2] #first element in first row is 4

#a multidimensional structure to store staff
points = [[A,B,C],[D,E,F]]
# ---------- end ghpython_script ----------
ghpython_script_2 = GhPythonScript()  # -> out, oGeometry
# ---------- ghpython_script_2: Python ----------
import Rhino.Geometry as rg
import math

points = []
lines = []


for i in range(0, 50):
    row = []
    for j in range(0,50):
        z = 3*math.sin(0.2*i)*math.sin(0.2*j)
        row.append(rg.Point3d(i,j,z))
    points.append(row)


for i in range(0,49):
    for j in range(0,49):
        lines.append(rg.Line(points[i][j],points[i+1][j+1]))
        lines.append(rg.Line(points[i+1][j],points[i][j+1]))
        
oGeometry = lines
# ---------- end ghpython_script_2 ----------
ghpython_script_3 = GhPythonScript()  # -> out, oGeometry, colors
# ---------- ghpython_script_3: Python ----------
import random
import Rhino.Geometry as rg
import math
import System.Drawing as dr

random.seed(1)
points = []
colors = []

for i in range(230, 280):
    for j in range(0, 50):
       # variation = (i-120)/100
        variation = math.sin(i*0.1)*0.5 +0.5
        x = i + random.uniform(-1.0,1.0)* variation
        y = j +random.uniform(-1.0,1.0)* variation
        points.append(rg.Point3d(x, y, 0))
        
        red = 255 * (i-230) /49
        blue = 255 - 255 *(i-230)/49
        color = dr.Color.FromArgb(red, random.randint(0,255), blue)
        colors.append(color)
        
oGeometry = points
# ---------- end ghpython_script_3 ----------
ghpython_script_4 = GhPythonScript()  # -> out, a
# ---------- ghpython_script_4: Python ----------
import System.Drawing as dr

oColor = dr.Color.FromArgb(0,0,255)
# ---------- end ghpython_script_4 ----------
ghpython_script_5 = GhPythonScript()  # -> out, a
# ---------- ghpython_script_5: Python ----------
import Rhino.Geometry as rg
import random

random.seed(10) #fake random number already stored so use seed to change
print random.randint(0,5)
#seed change acording to the windows clock time
#vray use random number to generate rays so we have lots of noise

#get 10 integer
for i in range(0,10):
    number = random.randint(0,5)
    print number

#get 10 float
for i in range(0,10):
    number = random.uniform(1.2, 5.0)
    print number
# ---------- end ghpython_script_5 ----------
line = Line(ghpython_script_2.oGeometry)
custom_preview = CustomPreview(Geometry=ghpython_script_3.oGeometry, Material=ghpython_script_3.colors)
panel_11 = Panel(ghpython_script_5.out)
ghpython_script_6 = GhPythonScript()  # -> out, oGeometry
# ---------- ghpython_script_6: Python ----------
import Rhino.Geometry as rg
import math
curves = []

for i in range(300,400,2):
    points = []
    for j in range(300,400,2):
        z = 3*math.sin(0.1*i)*math.sin(0.1*j)
        points.append(rg.Point3d(i,j,z))
    curve = rg.NurbsCurve.CreateInterpolatedCurve(points,3)
    curves.append(curve)
    
breps = rg.Brep.CreateFromLoft(curves, rg.Point3d.Unset,rg.Point3d.Unset, rg.LoftType.Normal, False)
oGeometry = breps # brep is a list od objects,is a static data type

#Normal commend is uesd afeter u have the object, but the static one can start without object like brep
#static function need to say the class first

# mypoint.DistanceTo(yourpoint)
# ---------- end ghpython_script_6 ----------
ghpython_script_7 = GhPythonScript()  # -> out, oGeometry; same code as ghpython_script_6
ghpython_script_8 = GhPythonScript()  # -> out, oGeometry; same code as ghpython_script_6
ghpython_script_9 = GhPythonScript()  # -> out, oGeometry; same code as ghpython_script_6
ghpython_script_10 = GhPythonScript(variation=Slider(0.8, range=0..1))  # -> out, oGeometry
# ---------- ghpython_script_10: Python ----------
import random
import Rhino.Geometry as rg
import math

random.seed(1)
points = []

for i in range(120, 220):
    for j in range(0, 50):
       # variation = (i-120)/100
        variation = math.sin(i*0.1)*0.5 +0.5
        x = i + random.uniform(-1.0,1.0)* variation
        y = j + random.uniform(-1.0,1.0)* variation
        points.append(rg.Point3d(x, y, 0))
        
oGeometry = points
# ---------- end ghpython_script_10 ----------
ghpython_script_11 = GhPythonScript(iCount=Slider(72, range=0..100))  # -> out, oGeometry; inputs iCount: Int32
# ---------- ghpython_script_11: Python ----------
import random
import Rhino.Geometry as rg

points = []

for i in range(0,iCount):
    x = random.uniform(60.0, 110.0)
    y = random.uniform(0.0, 50.0)
    points.append(rg.Point3d(x, y, 0.0))
    
oGeometry = points
# ---------- end ghpython_script_11 ----------
brep = Brep(ghpython_script_6.oGeometry)
brep_2 = Brep(ghpython_script_7.oGeometry)
brep_3 = Brep(ghpython_script_8.oGeometry)
brep_4 = Brep(ghpython_script_9.oGeometry)
