# Grasshopper definition 20191112 function_tuples.gh (Grasshopper 1.0.7)
# plug-ins: Bifocals

panel = Panel("Functions")
panel_2 = Panel("Interpolated Curve")
panel_3 = Panel("Tuples")
# functions return multiple value
# return a, b
# actually create a tuple(a, b)
panel_4 = Panel("Functions")
panel_5 = Panel("Control Point Curve")
# control points are better to design sth, interpolated curves are actually inner generated control points, they are suitable for reconstruct the already designed curves
# Why degree 3 is default?
# Degree 2 is smooth but not enough.
number_slider = Slider(3, range=0..10)
ghpython_script = GhPythonScript()  # -> out, a
# ---------- ghpython_script: Python ----------
import math

#calculate cylinder_volume
def ComputeCylinderVolume(r, h):
    base_area = r * r * math.pi
    volumn = base_area * h
    return volumn


volume1 = ComputeCylinderVolume(2.1, 3.2)
volume2 = ComputeCylinderVolume(3.6, 1.7)
print volume1
print volume2

#function is like a black box
# ---------- end ghpython_script ----------
ghpython_script_2 = GhPythonScript()  # -> out, a
# ---------- ghpython_script_2: Python ----------
import Rhino.Geometry as rg
import math

def ComputeAverage(numbers): #define a function(parameter)
    sum = 0 #body of the mini_program
    for number in numbers:
        sum = sum + number
    average = sum / len(numbers)
    return average #return value

numbers = [10,23,4,53,12,6]
#[]is the argument for the parameter input
result = ComputeAverage(numbers)#invoke the function
print result
# ---------- end ghpython_script_2 ----------
point = Point(Point(42.63912311, -54.14982993, 0))
point_2 = Point(Point(-50.27036147, -9.47446823, 0))
point_3 = Point(Point(44.47190302, 11.13180324, 0))
# type1: noemal python functions
# type2: method functions associated with specific data type
# type3:static function(static medthod) of a class
# tuples are more light weight than lists, goes faster
point_4 = Point(Point(-36.55574062, 57.50055307, 0))
point_5 = Point([Point(90.53686367, 19.28332272, 0), Point(94.72324549, 51.37142931, 0), Point(114.9065684, 25.28482765, 0), Point(126.9446003, 47.68284736, 0), Point(136.130585, 16.98996778, 0), Point(147.32482, 42.88638929, 0), Point(167.2897255, 23.53355816, 0)])
ghpython_script_3 = GhPythonScript(A=point_2, B=point, C=point_3, D=point_4)  # -> out, oMidLine; inputs A: Point3d, B: Point3d, C: Point3d, D: Point3d
# ---------- ghpython_script_3: Python ----------
import Rhino.Geometry as rg
import math

def ComputeMidpt(A,B):
    return (A+B)*0.5

def CreateMidLine(A, B, C, D):
    M = ComputeMidpt(A,B)
    N = ComputeMidpt(C,D)
    return rg.Line(M,N)

oMidLine = CreateMidLine(A,B,C,D)
# ---------- end ghpython_script_3 ----------
ghpython_script_4 = GhPythonScript(iPoints=point_5)  # -> out, oCurve; inputs iPoints: list of Point3d
# ---------- ghpython_script_4: Python ----------
import Rhino.Geometry as rg

oCurve = rg.Curve.CreateInterpolatedCurve(iPoints,3)
# ---------- end ghpython_script_4 ----------
nurbs_curve = NurbsCurve(Vertices=point_5, Degree=number_slider, Periodic=False)  # -> Curve, Length, Domain
ghpython_script_5 = GhPythonScript()  # -> out, a
# ---------- ghpython_script_5: Python ----------
import Rhino.Geometry as rg

def CreateTriSurface(A,B,C):
    CB = rg.LineCurve(C,B)
    BA = rg.LineCurve(B,A)
    AC = rg.LineCurve(A,C)
    return rg.Brep.CreateEdgeSurface()

#compute the center of 4p, normal of4p
def CreateComponentSurfaces(frameA, frameB,frameC,frameD, height):
# ---------- end ghpython_script_5 ----------
line = Line(ghpython_script_3.oMidLine)
ghpython_script_6 = GhPythonScript(iPoints=point_5)  # -> out, oFrame, oCurve; inputs iPoints: list of Point3d
# ---------- ghpython_script_6: Python ----------
import Rhino.Geometry as rg

curve = rg.Curve.CreateControlPointCurve(iPoints, 3)
curve.Domain = rg.Interval(0.0,1.0)
frame = curve.FrameAt(0.5)


oFrame = frame
oCurve = curve

results = curve.ClosestPoint(iTestPoint)
tClosestPoint = result[1]
oGeometry = curve.curve.PointAt(tClosestPoint)
# ---------- end ghpython_script_6 ----------
