# Grasshopper definition 20191126 mesh.gh (Grasshopper 1.0.7)
# plug-ins: Bifocals

# ----
# 1126
# meshes in rhino
# vertex array
# 0 = {0.0, 0.0, 0.0}
# face array
# A = {0,1,5,4}
# 面的方向遵循右手定则。
# mesh shares vertexes改变一个节点的坐标会影响面。
# Not sharing vertices means only change one face when change one vertex
point = Point(Point(-8.170263139, -6.826707316, 0))
point_2 = Point()
point_3 = Point(Point(14.69198192, -6.862627084, 0))
point_4 = Point(Point(2.675612972, 16.25412282, 0))
point_5 = Point()
point_6 = Point(Point(1.14574057, -0.7490192868, 14.41339733))
point_7 = Point(Point(-8.170263139, -6.826707316, 0))
point_8 = Point()
point_9 = Point(Point(14.69198192, -6.862627084, 0))
point_10 = Point(Point(2.675612972, 16.25412282, 0))
point_11 = Point()
point_12 = Point(Point(1.14574057, -0.7490192868, 14.41339733))
ghpython_script = GhPythonScript(iA=point_7, iB=point_9, iC=point_10, iD=point_12)  # -> out, oMesh; inputs iA: Point3d, iB: Point3d, iC: Point3d, iD: Point3d
# ---------- ghpython_script: Python ----------
import Rhino.Geometry as rg

mesh = rg.Mesh()# Createe empty mesh

# Manually add 4 vertices
mesh.Vertices.Add(iA)
mesh.Vertices.Add(iB)
mesh.Vertices.Add(iC)
mesh.Faces.AddFace(1,2,3)

mesh.Vertices.Add(iD)
mesh.Vertices.Add(iA)
mesh.Vertices.Add(iB)
mesh.Faces.AddFace(4,5,6)

mesh.Vertices.Add(iD)
mesh.Vertices.Add(iB)
mesh.Vertices.Add(iC)
mesh.Faces.AddFace(7,8,9)

mesh.Vertices.Add(iD)
mesh.Vertices.Add(iC)
mesh.Vertices.Add(iA)
mesh.Faces.AddFace(10,11,12)



oMesh = mesh
# ---------- end ghpython_script ----------
ghpython_script_2 = GhPythonScript(iA=point, iB=point_3, iC=point_4, iD=point_6)  # -> out, oMesh; inputs iA: Point3d, iB: Point3d, iC: Point3d, iD: Point3d
# ---------- ghpython_script_2: Python ----------
import Rhino.Geometry as rg

mesh = rg.Mesh()# Createe empty mesh

# Manually add 4 vertices
mesh.Vertices.Add(iA)
mesh.Vertices.Add(iB)
mesh.Vertices.Add(iC)
mesh.Vertices.Add(iD)

# Add faces
mesh.Faces.AddFace(2,1,0)# oder CBA points downward
mesh.Faces.AddFace(1,2,3)
mesh.Faces.AddFace(0,1,3)
mesh.Faces.AddFace(2,0,3)
oMesh = mesh
# ---------- end ghpython_script_2 ----------
panel = Panel("""Flat Shading网格平滑
Color Backfaces背面颜色""")

# ----
# mesh querry is simple but change is complex.
# vector3f(float)
# vector3d(double)
# in C# v3f takes more storage space than v3d
# vector3f:cannot math.compute directly, need to be transferred into v3d
# move vertices by v ertex normal
# vertices color by vertex
panel_2 = Panel("vertices color random")
inflate_distancce = Slider(0.2, range=0..0.3)
mesh = Mesh(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)
mesh_2 = Mesh(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)
mesh_3 = Mesh(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)
python = GhPythonScript(iMesh=mesh)  # -> out, oMesh; inputs iMesh: Mesh
# ---------- python: Python ----------
import Rhino.Geometry as rg
import System.Drawing as drawing
import random

for i in range(iMesh.Vertices.Count):
    red = iMesh.Vertices[i].Z/5*255
    if red>255: red = 255
    green = random.uniform(0, 255)
    blue = random.uniform(0, 255)
    randomColor = drawing.Color.FromArgb(255, red, green, blue)
    iMesh.VertexColors.SetColor(i, randomColor)
    
a = iMesh
# ---------- end python ----------
python_2 = GhPythonScript(iMesh=mesh_2)  # -> out, oMesh; inputs iMesh: Mesh
# ---------- python_2: Python ----------
import Rhino.Geometry as rg
import System.Drawing as drawing
import random

for i in range(iMesh.Vertices.Count):
    red = random.uniform(0, 255)
    green = random.uniform(0, 255)
    blue = random.uniform(0, 255)
    randomColor = drawing.Color.FromArgb(255, red, green, blue)
    iMesh.VertexColors.SetColor(i, randomColor)
    
a = iMesh
# ---------- end python_2 ----------
python_3 = PythonScript(iMesh=mesh_3, iInflateDistance=inflate_distancce)  # -> out, oGeometry; inputs iMesh: Mesh; unedited script template
custom_preview = CustomPreview(
    Geometry=python.oMesh,
    Material={diffuse=RGB(221, 160, 221), emission=RGB(66, 48, 66), shine=0.5, specular=RGB(255, 255, 255), transparency=0})
custom_preview_2 = CustomPreview(
    Geometry=python_2.oMesh,
    Material={diffuse=RGB(221, 160, 221), emission=RGB(66, 48, 66), shine=0.5, specular=RGB(255, 255, 255), transparency=0})

# ----
# Vertex Normal(unit vector)
# normal vector of a vertex
# 一般用两边面的法线Face Normal的平均来定义
# 
# Mesh is a approx. of surface, so we need to define a vextor which points the same direction of the original surface.
# Condition!!： shared vertices
# App:
# compute normal vector of a point on surface:
# we don't use face vector, instead, we use weighted ave. of vertex normals.
# Mesh from UV surface -triangle
# App:
# compute normal vector of a point on surface:
# we don't use face vector, instead, we use weighted ave. of vertex normals.
pt = Point([Point(0.1453333915, -12, -4.200370007), Point(-0.561224943, -1, -5.35410523), Point(0.04462376078, 11, 5.316281991)])
pt_2 = Point([Point(-8, -12, 0), Point(-9.744231068, -1, 8.712464232), Point(-8, 11, 0)])
pt_3 = Point([Point(7.456778476, -12, 0), Point(8.377067306, -1, -3.113435892), Point(7.520270272, 11, 3.973962414)])
entwine = Entwine(Branch00=pt_2, Branch01=pt, Branch02=pt_3, FlattenInputs=True)
intcrv = Interpolate(Vertices=entwine, Degree=3, Periodic=False, KnotStyle=1)  # -> flatten(Curve), Length, Domain
u_division = Slider(5, range=0..50)
u_division_2 = Slider(5, range=0..50)
loft = Loft(Curves=intcrv.Curve, Options={Adjust=False, Closed=False, LoftEnds=0, LoftSimp=0, LoftType=0, Rebuild=10, Refit=0.01})
python_4 = PythonScript(iSurface=loft, iUDivision=u_division_2, iVDivision=u_division)  # -> out, oVertices, oNormals, oGeometry; inputs iSurface: Surface, iUDivision: Int32, iVDivision: Int32
# ---------- python_4: Python ----------
import Rhino.Geometry as rg

iSurface.SetDomain(0,rg.Interval(0.0,1.0))
iSurface.SetDomain(1,rg.Interval(0.0,1.0))

mesh = rg.Mesh()

for i in range(0, iUDivision+1):
    for j in range(0, iVDivision+1):
        u = i/iUDivision
        v = j/iVDivision
        mesh.Vertices.Add(iSurface.PointAt(u,v))
    
def GerVertexIndex(i,j):
    return i * (iVDivision+1) +j
    
for i in range(0, iUDivision):
    for j in range(0, iVDivision):
        v1 = GerVertexIndex(i,j)
        v2 = GerVertexIndex(i+1,j)
        v3 = GerVertexIndex(i+1,j+1)
        v4 = GerVertexIndex(i,j+1)
        if (i+j)%2 == 0:
            mesh.Faces.AddFace(v1,v2,v3)
            mesh.Faces.AddFace(v1,v3,v4)
        else:
            mesh.Faces.AddFace(v1,v2,v4)
            mesh.Faces.AddFace(v2,v3,v4)
        
oGeometry = mesh
mesh.Normals.ComputeNormals()
oNormals = mesh.Normals#list quote 01234
oVertices = mesh.Vertices
# ---------- end python_4 ----------
vector_display = VectorDisplay(Anchor=python_4.oVertices, Vector=python_4.oNormals)
mesh_4 = Mesh(python_4.oGeometry)

# ----
# Mesh from UV surface - quad
# save mathematical data in computer
# when displaying, it will create triangles into graphic card, so for complex surface, the display will be really slow, but generation goes fast.
# Mesh from UV surface - triangle
pt_4 = Point([Point(0.1453333915, -12, -4.200370007), Point(-0.561224943, -1, 0), Point(0.04462376078, 11, 5.316281991)])
pt_5 = Point([Point(7.456778476, -12, 0), Point(8.377067306, -1, -3.113435892), Point(7.520270272, 11, 3.973962414)])
pt_6 = Point([Point(-8, -12, 0), Point(-9.744231068, -1, 8.712464232), Point(-8, 11, 0)])
pt_7 = Point([Point(-8, -12, 0), Point(-9.744231068, -1, 8.712464232), Point(-8, 11, 0)])
pt_8 = Point([Point(0.1453333915, -12, -4.200370007), Point(-0.561224943, -1, -5.35410523), Point(0.04462376078, 11, 5.316281991)])
pt_9 = Point([Point(7.456778476, -12, 0), Point(8.377067306, -1, -3.113435892), Point(7.520270272, 11, 3.973962414)])
entwine_2 = Entwine(Branch00=pt_6, Branch01=pt_4, Branch02=pt_5, FlattenInputs=True)
entwine_3 = Entwine(Branch00=pt_7, Branch01=pt_8, Branch02=pt_9, FlattenInputs=True)
intcrv_2 = Interpolate(Vertices=entwine_2, Degree=3, Periodic=False, KnotStyle=1)  # -> flatten(Curve), Length, Domain
intcrv_3 = Interpolate(Vertices=entwine_3, Degree=3, Periodic=False, KnotStyle=1)  # -> flatten(Curve), Length, Domain
u_division_3 = Slider(10, range=0..50)
u_division_4 = Slider(9, range=0..20)
u_division_5 = Slider(13, range=0..50)
v_division = Slider(6, range=0..20)
loft_2 = Loft(Curves=intcrv_2.Curve, Options={Adjust=False, Closed=False, LoftEnds=0, LoftSimp=0, LoftType=0, Rebuild=10, Refit=0.01})
loft_3 = Loft(Curves=intcrv_3.Curve, Options={Adjust=False, Closed=False, LoftEnds=0, LoftSimp=0, LoftType=0, Rebuild=10, Refit=0.01})
python_5 = PythonScript(iSurface=loft_2, iUDivision=u_division_4, iVDivision=v_division)  # -> out, oGeometry; inputs iSurface: Surface, iUDivision: Int32, iVDivision: Int32
# ---------- python_5: Python ----------
import Rhino.Geometry as rg

iSurface.SetDomain(0,rg.Interval(0.0,1.0))
iSurface.SetDomain(1,rg.Interval(0.0,1.0))

mesh = rg.Mesh()

for i in range(0, iUDivision+1):
    for j in range(0, iVDivision+1):
        u = i/iUDivision
        v = j/iVDivision
        mesh.Vertices.Add(iSurface.PointAt(u,v))
    
def GerVertexIndex(i,j):
    return i * (iVDivision+1) +j
    
for i in range(0, iUDivision):
    for j in range(0, iVDivision):
        v1 = GerVertexIndex(i,j)
        v2 = GerVertexIndex(i+1,j)
        v3 = GerVertexIndex(i+1,j+1)
        v4 = GerVertexIndex(i,j+1)
        mesh.Faces.AddFace(rg.MeshFace(v1,v2,v3,v4))
        
oGeometry = mesh
# ---------- end python_5 ----------
python_6 = PythonScript(iSurface=loft_3, iUDivision=u_division_5, iVDivision=u_division_3)  # -> out, oGeometry; inputs iSurface: Surface, iUDivision: Int32, iVDivision: Int32
# ---------- python_6: Python ----------
import Rhino.Geometry as rg

iSurface.SetDomain(0,rg.Interval(0.0,1.0))
iSurface.SetDomain(1,rg.Interval(0.0,1.0))

mesh = rg.Mesh()

for i in range(0, iUDivision+1):
    for j in range(0, iVDivision+1):
        u = i/iUDivision
        v = j/iVDivision
        mesh.Vertices.Add(iSurface.PointAt(u,v))
    
def GerVertexIndex(i,j):
    return i * (iVDivision+1) +j
    
for i in range(0, iUDivision):
    for j in range(0, iVDivision):
        v1 = GerVertexIndex(i,j)
        v2 = GerVertexIndex(i+1,j)
        v3 = GerVertexIndex(i+1,j+1)
        v4 = GerVertexIndex(i,j+1)
        if (i+j)%2 == 0:
            mesh.Faces.AddFace(v1,v2,v3)
            mesh.Faces.AddFace(v1,v3,v4)
        else:
            mesh.Faces.AddFace(v1,v2,v4)
            mesh.Faces.AddFace(v2,v3,v4)
        
oGeometry = mesh
# ---------- end python_6 ----------
mesh_5 = Mesh(python_5.oGeometry)
mesh_6 = Mesh(python_6.oGeometry)
