# Grasshopper definition 20191203 Iteration.gh (Grasshopper 1.0.7)

# Persistent Data
# pt with random vector
number_slider = Slider(0.037, range=0..0.1)
timer = Timer(TimerInterval=20, Target=python_3)  # disabled
# Render is slow but computation is quick.
panel = Panel("""Persistent Data 
number""")
toggle = BooleanToggle(False)
toggle_2 = BooleanToggle(False)
# Persistent Data Animate Geometry
timer_2 = Timer(TimerInterval=20, Target=python)  # disabled
# Persistent Data Change vector
timer_3 = Timer(TimerInterval=20, Target=python_2)  # disabled
# Persistent Data Change vector
number_slider_2 = Slider(0, range=0..0.1)
timer_4 = Timer(TimerInterval=20, Target=python_5)  # disabled
timer_5 = Timer(TimerInterval=20, Target=python_4)  # disabled
python = GhPythonScript(iReset=Button())  # -> out, a; inputs iReset: Boolean
# ---------- python: Python ----------
if iReset:
    n = 0
else:
    n += 1

a = n
# ---------- end python ----------
python_2 = GhPythonScript(iReset=Button())  # -> out, a; inputs iReset: Boolean
# ---------- python_2: Python ----------
import Rhino.Geometry as rg

if iReset:
    point = rg.Point3d(0,0,0)
else:
    point += rg.Vector3d(0.1,0.1,0.1)

a = point
# ---------- end python_2 ----------
vec = VectorXYZ(XComponent=Slider(0.058, range=0..0.1), YComponent=Slider(0.006, range=0..0.1), ZComponent=number_slider)  # -> Vector, Length
vec_2 = VectorXYZ(XComponent=Slider(0.028, range=0..0.1), YComponent=Slider(0.042, range=0..0.1), ZComponent=number_slider_2)  # -> Vector, Length
vec_3 = VectorXYZ(XComponent=Slider(0.058, range=0..0.1), YComponent=Slider(0.006, range=0..0.1), ZComponent=Slider(0.037, range=0..0.1))  # -> Vector, Length
panel_2 = Panel(python.a)
panel_3 = Panel(python_2.a)
python_3 = GhPythonScript(iReset=Button(), iVel=vec.Vector)  # -> out, a; inputs iReset: Boolean
# ---------- python_3: Python ----------
import Rhino.Geometry as rg

if iReset:
    point = rg.Point3d(0,0,0)
    historyls = [point]
else:
    point += rg.Vector3d(iVel)
    historyls.append(point)
a = historyls
# ---------- end python_3 ----------
python_4 = GhPythonScript(iReset=Button(), iVel=vec_3.Vector)  # -> out, a; inputs iReset: Boolean
# ---------- python_4: Python ----------
import Rhino.Geometry as rg
import random

if iReset:
    point = rg.Point3d(0,0,0)
    historyls = [point]
else:
    point += rg.Vector3d(random.uniform(-1,1),random.uniform(-1,1),0)
    historyls.append(point)
    
a = historyls
# ---------- end python_4 ----------
python_5 = GhPythonScript(iReset=Button(), iVel=vec_2.Vector)  # -> out, a; inputs iReset: Boolean
# ---------- python_5: Python ----------
import Rhino.Geometry as rg

if iReset:
    point = rg.Point3d(0,0,0)
else:
    point += rg.Vector3d(iVel)

a = point
# ---------- end python_5 ----------
panel_4 = Panel(python_3.a)
panel_5 = Panel(python_4.a)
panel_6 = Panel(python_5.a)
panel_7 = Panel("Cellular Automata")
panel_8 = Panel("Cellular Automata Square")
timer_6 = Timer(TimerInterval=20, Target=python_6)  # disabled
timer_7 = Timer(TimerInterval=500, Target=python_7)  # disabled
python_6 = GhPythonScript(iReset=Button())  # -> out, oGeometry; inputs iReset: Boolean
# ---------- python_6: Python ----------
import Rhino.Geometry as rg
def ComputeNextStates(states):
    nextstates = []
    for i in range(0, len(states)):
        nei = []
        nei.append(states[i-1])
        nei.append(states[i])
        if i == len(states)-1: nei.append(states[0])
        else:nei.append(states[i+1])
        if nei == [0,0,0]: nextstates.append(0)
        elif nei == [0,0,1]: nextstates.append(1)
        elif nei == [0,1,0]: nextstates.append(1)        
        elif nei == [0,1,1]: nextstates.append(0)
        elif nei == [1,0,0]: nextstates.append(1)
        elif nei == [1,0,1]: nextstates.append(0)
        elif nei == [1,1,0]: nextstates.append(0)
        elif nei == [1,1,1]: nextstates.append(1)
    return nextstates
    
if iReset:
    states = [0,0,0,0,0,0,1,0,0,0,0,0,0]
    iteration = 0
    mesh = rg.Mesh()
    
else:
    states = ComputeNextStates(states)
    iteration += 1

print "current iteration"+str(iteration)
print(states)

#draw script
for i in range(0,len(states)):
    if states[i] == 1:
        mesh.Vertices.Add(i, iteration, 0)
        mesh.Vertices.Add(i+1, iteration, 0)
        mesh.Vertices.Add(i+1, iteration+1,0)
        mesh.Vertices.Add(i, iteration+1, 0)
        v = mesh.Vertices.Count
        mesh.Faces.AddFace(v-4, v-3, v-2, v-1)
        
oGeometry = mesh
# ---------- end python_6 ----------
python_7 = GhPythonScript(iReset=Button())  # -> out, oGeometry; inputs iReset: Boolean
# ---------- python_7: Python ----------
import Rhino.Geometry as rg

def ComputeNextStates(states):
    nextstates = []
    for i in range(0,n):
        listzero = [0]*n
        nextstates.append(listzero)
        
    for i in range(1, n-1):
        for j in range(1, n-1):
            neinum  = states[i-1][j-1]+states[i][j-1]+states[i+1][j-1]+states[i-1][j]+states[i+1][j]+states[i-1][j+1]+states[i][j+1]+states[i+1][j+1]
            if neinum == 2 or neinum == 3:
                nextstates[i][j] = 1

    return nextstates

def DrawMesh(n, states):
    mesh = rg.Mesh()
    for i in range(0,n):
        for j in range(0,n):
            if states[i][j] == 1:
                mesh.Vertices.Add(rg.Point3d(i, j, 0))
                mesh.Vertices.Add(rg.Point3d(i+1, j, 0))
                mesh.Vertices.Add(rg.Point3d(i+1, j+1,0))
                mesh.Vertices.Add(rg.Point3d(i, j+1, 0))
                v = mesh.Vertices.Count
                mesh.Faces.AddFace(v-4, v-3, v-2, v-1)
    return mesh



if iReset:
    n = 20
    states = []
    for i in range(0,n):
        listzero = [0]*n #get the list of n 0
        states.append(listzero)
    states[9][10] = 1
    states[10][9] = 1
    states[10][10] = 1
    states[9][9] = 1
    iteration = 0

else:
    states = ComputeNextStates(states)
    iteration += 1

oGeometry = DrawMesh(n, states)

print "current iteration"+str(iteration)
print(states)
# ---------- end python_7 ----------
mesh = Mesh(python_6.oGeometry)
mesh_2 = Mesh(python_7.oGeometry)
panel_9 = Panel(python_6.out)
panel_10 = Panel(python_7.out)
